# Grasshopper definition ParametricCircle.gh (Grasshopper 1.0.7)

# Number sliders adjust values ex. radius
number_slider = Slider(63.5, range=0..80)
number_slider_2 = Slider(31.75, range=0..80)
# Using subtract to adjust the rectangle position for trimming.
number_slider_3 = Slider(3.2, range=0..80)
# Circle component used to make the base of my shape. Set the radius to be 2.5 inches.
subtraction = Subtraction(A=number_slider, B=number_slider_2)
# Rectangle component used to make press-fit notches.
rectangle = Rectangle(Plane=PlaneXY(0, 0, 0), XSize=number_slider_3, YSize=number_slider_2, Radius=0)  # -> Rectangle, Length
# Division is the math being used to move rectangle slot using the width of the rect.
# Set “B” to -2
division = Division(A=number_slider_3, B=-2)
# Vector uses math to specifcy the motion of the rectangle slot.
vec = VectorXYZ(XComponent=division, YComponent=subtraction, ZComponent=0)  # -> Vector, Length
# Move component used to move the press-fit slots over to the edges of the circle component.
move = Move(Geometry=rectangle.Rectangle, Motion=vec.Vector)  # -> Geometry, Transform
cir = Circle(Plane=PlaneXY(0, 0, 0), Radius=number_slider)
# Polar array creates multiple/parametric
# slots. N is count.
arrpolar = PolarArray(Geometry=move.Geometry, Plane=PlaneXY(0, 0, 0), Count=Slider(2, range=0..20), Angle=6.283185307)  # -> Geometry, Transform
# Trim with regions to open up slots.
trim = TrimWithRegions(Curve=arrpolar.Geometry, Regions=cir)  # -> flatten(Inside), flatten(Outside)
# Trim with regions to open up slots.
trim_2 = TrimWithRegions(Curve=cir, Regions=arrpolar.Geometry)  # -> Inside, Outside
# Functions like join in normal rhino
join = JoinCurves(Curves=[trim_2.Outside, trim.Inside], Preserve=False)
